% Simulink data dictionary system_data.sldd

CarrierResolution = Simulink.Parameter(1000)  % キャリア分解能
DeadTime = Simulink.Parameter(Simulink.data.Expression(ExpressionString=" DeadTimeRate * CarrierTime"))
DeadTimeRate = Simulink.Parameter(0.05)  % 1周期当たりのデッドタイムの割合
CarrierTime = Simulink.Parameter(0.0001, Unit="s")  % PWMのキャリア周期
Init_time = Simulink.Parameter(Simulink.data.Expression(ExpressionString=" TimeStep / 2"))  % 初期化時間
Reactance = Simulink.Parameter(0.002)  % リアクタンス
SimulationTimeStep = Simulink.Parameter(1.0e-6)  % シミュレーション時間刻み
DC_Capacitance = Simulink.Parameter(0.0047, Unit="F")  % DCキャパシタンス
EDLC_InitialVoltage = Simulink.Parameter(200, Unit="V")  % EDLC初期電圧
DC_InitialVoltage = Simulink.Parameter(400)  % DC電源初期値
TimeStep = Simulink.Parameter(0.0001, Unit="s")  % 制御の計算タイムステップ
sensCutoff_Freq = Simulink.Parameter(1000, Unit="Hz")  % センサーのLPFのカットオフ周波数
ctrl_start_time = Simulink.Parameter(0.005, Unit="s")  % 制御を開始する時間
deadzone_comp_val = Simulink.Parameter(Simulink.data.Expression(ExpressionString="DeadTimeRate"))

deadzone_comp_flag = Simulink.Parameter(1, DataType="boolean")  % 1のとき、不感帯保証を行う
  % 0のとき、行わない

P_gain_init = Simulink.Parameter(0.01)  % Pゲイン初期値
I_gain_init = Simulink.Parameter(0.5)  % Iゲイン初期値
af_math_model_num = Simulink.Parameter([0 0.4665119])  % 数式モデルのローパスフィルタの分子
af_math_model_den = Simulink.Parameter([1 -0.5334881])  % 数式モデルのローパスフィルタの分母
V_D_fix_gain = Simulink.Parameter(1)  % 数式モデルのV_D積分ゲイン
SimEndTime = Simulink.Parameter(0.8, Unit="s")  % シミュレーション終了時間
EDLC_internal_R = Simulink.Parameter(0.01)
EDLC_Capacitance = Simulink.Parameter(0.1, Unit="F")  % EDLCキャパシタンス
V_E_fix_gain = Simulink.Parameter(1)  % 数式モデルのV_E積分ゲイン